# Grasshopper definition RGB8 diffs.gh (Grasshopper 1.0.7)

# each box is a "vol"
brep = Brep([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])
box = Box(brep)
debox = DeconstructBox(Box=box)  # -> Plane, X, Y, Z
dedom = DeconstructDomain(Domain=debox.X)  # -> Start, End
dedom_2 = DeconstructDomain(Domain=debox.Y)  # -> Start, End
dedom_3 = DeconstructDomain(Domain=debox.Z)  # -> Start, End
pt = ConstructPoint(XCoordinate=dedom.Start, YCoordinate=dedom_2.Start, ZCoordinate=dedom_3.Start)
pt_2 = ConstructPoint(XCoordinate=dedom.End, YCoordinate=dedom_2.End, ZCoordinate=dedom_3.End)
pt_3 = Point(Point(1, 1, 1))
addition = Addition(A=pt_2, B=pt_3)
vec2pt = Vector2Pt(PointA=pt, PointB=addition, Unitize=False)  # -> Vector, Length
python = GhPythonScript(x=pt, y=vec2pt.Vector)  # -> out, a; inputs x: list of Point3d, y: list of Point3d
# ---------- python: Python ----------
__author__ = "Atlas"
__version__ = "2023.10.15"

import rhinoscriptsyntax as rs

a = []
i = 0
for pt, dim in zip(x, y):
    #print(dir(pt))
    
    #print(pt.Origin)
    #aa
    #print(dim)
    pt = (int(pt.X), int(pt.Y), int(pt.Z))
    dim = (int(dim.X), int(dim.Y), int(dim.Z))
    
    if dim[0] > 6:
        size = 2
    else:
        size = 1
    
    a.append('["vol{0}", {1}],'.format(i, size))
    
    print("[{0}, {1}, {2}],".format(pt, dim, size))
    i += 1
# ---------- end python ----------
panel = Panel(python.a)
join = TextJoin(Text=python.out)
rep = ReplaceText(Text=join, Find=", ", Replace=",", RecursiveReplace=False)
panel_2 = Panel(rep)
